# Dynamo graph UG1_tunnel_from_pointcloud.dyn "workshop" (Dynamo 2.17.0.3472)

file_path = Filename(".\output.csv")
importCSV = Data.ImportCSV(filePath=file_path)
code_block = CodeBlock(x=importCSV, y=importCSV, z=importCSV) { x[0]; y[1]; z[2]; }
byCoordinates = Point.ByCoordinates(x=code_block.out0, y=code_block.out1, z=code_block.out2)
python_script = Python(IN[0]=byCoordinates)  # CPython3
# ---------- python_script.python (13 lines) ----------
import sys
import clr
clr.AddReference('ProtoGeometry')
from Autodesk.DesignScript.Geometry import *

points_list = IN[0]

grouped_points = []

for i in range(0, len(points_list), 15):
    grouped_points.append(points_list[i:i+15])

OUT = grouped_points
# ----------------------------------------
family_types = FamilyTypes("tunnel_void:tunnel_void")
byPoints = AdaptiveComponent.ByPoints(points=python_script, familyType=family_types)
