# Dynamo graph UG2_Block.dyn "UG1_Block" (Dynamo 2.17.0.3472)

# group: Generate Block model
# taking 1 and half hour to generate model with i7-12700h
file_path = Filename(".\Bm_dimensions0_test.csv")  # frozen
python_script = Python(IN[0]=file_path)  # CPython3
# ---------- python_script.python (32 lines) ----------
import sys
import clr
clr.AddReference('ProtoGeometry')
from Autodesk.DesignScript.Geometry import *
sys.path.append(r'D:\Anaconda\envs\Dynamo3912\Lib\site-packages')
import numpy as np
import pandas as pd

df = pd.read_csv(IN[0])
df[["X", "Y", "Z","size(X)","size(Y)","size(Z)"]] = df[["X", "Y", "Z","size(X)","size(Y)","size(Z)"]] * 1000

X = df["X"].to_numpy()
Y = df["Y"].to_numpy()
Z = df["Z"].to_numpy()
sX = df["size(X)"].to_numpy()/2
sY = df["size(Y)"].to_numpy()/2
sZ = df["size(Z)"].to_numpy()/2

point1 = (X-sX,Y+sY,Z+sZ)
point2 = (X-sX,Y+sY,Z-sZ)
point3 = (X+sX,Y+sY,Z-sZ)
point4 = (X+sX,Y+sY,Z+sZ)
point5 = (X-sX,Y-sY,Z+sZ)
point6 = (X-sX,Y-sY,Z-sZ)
point7 = (X+sX,Y-sY,Z-sZ)
point8 = (X+sX,Y-sY,Z+sZ)

final_X = [val for sublist in zip(point1[0],point2[0],point3[0],point4[0],point5[0],point6[0],point7[0],point8[0]) for val in sublist]
final_Y = [val for sublist in zip(point1[1],point2[1],point3[1],point4[1],point5[1],point6[1],point7[1],point8[1]) for val in sublist]
final_Z = [val for sublist in zip(point1[2],point2[2],point3[2],point4[2],point5[2],point6[2],point7[2],point8[2]) for val in sublist]

OUT = final_X, final_Y, final_Z
# ----------------------------------------
string_from_object = FromObject(object=python_script)
toNumber = String.ToNumber(string=string_from_object)
code_block = CodeBlock(x=toNumber) { x[0]; x[1]; x[2]; }
byCoordinates = Point.ByCoordinates(x=code_block.out0, y=code_block.out1, z=code_block.out2)
python_script_2 = Python(IN[0]=byCoordinates)  # CPython3
# ---------- python_script_2.python (13 lines) ----------
import sys
import clr
clr.AddReference('ProtoGeometry')
from Autodesk.DesignScript.Geometry import *

points_list = IN[0]

grouped_points = []

for i in range(0, len(points_list), 8):
    grouped_points.append(points_list[i:i+8])

OUT = grouped_points
# ----------------------------------------
family_types = FamilyTypes("block:block")
byPoints = AdaptiveComponent.ByPoints(points=python_script_2, familyType=family_types)
importCSV = Data.ImportCSV(filePath=file_path)
code_block_2 = CodeBlock(classification_no=importCSV, average_distance=importCSV, cu=importCSV, fek=importCSV, nearest_sample=importCSV, pb=importCSV, pyrite=importCSV, s=importCSV, sample_number=importCSV, sg=importCSV, zn=importCSV)
# ---------- code_block_2.designscript (11 lines) ----------
classification_no[3];
average_distance[7];
cu[8];
fek[9];
nearest_sample[10];
pb[11];
pyrite[12];
s[13];
sample_number[14];
sg[15];
zn[16];
# ----------------------------------------
firstItem = List.FirstItem(list=code_block_2.out0)
code_block_3 = CodeBlock { 1; }
dropItems = List.DropItems(list=code_block_2.out0, amount=code_block_3)
setParameterByName = Element.SetParameterByName(element=byPoints, parameterName=firstItem, value=dropItems)
firstItem_2 = List.FirstItem(list=code_block_2.out1)
dropItems_2 = List.DropItems(list=code_block_2.out1, amount=code_block_3)
setParameterByName_2 = Element.SetParameterByName(element=setParameterByName, parameterName=firstItem_2, value=dropItems_2)
firstItem_3 = List.FirstItem(list=code_block_2.out2)
dropItems_3 = List.DropItems(list=code_block_2.out2, amount=code_block_3)
setParameterByName_3 = Element.SetParameterByName(element=setParameterByName_2, parameterName=firstItem_3, value=dropItems_3)
firstItem_4 = List.FirstItem(list=code_block_2.out3)
dropItems_4 = List.DropItems(list=code_block_2.out3, amount=code_block_3)
setParameterByName_4 = Element.SetParameterByName(element=setParameterByName_3, parameterName=firstItem_4, value=dropItems_4)
firstItem_5 = List.FirstItem(list=code_block_2.out4)
dropItems_5 = List.DropItems(list=code_block_2.out4, amount=code_block_3)
setParameterByName_5 = Element.SetParameterByName(element=setParameterByName_4, parameterName=firstItem_5, value=dropItems_5)
firstItem_6 = List.FirstItem(list=code_block_2.out5)
dropItems_6 = List.DropItems(list=code_block_2.out5, amount=code_block_3)
setParameterByName_6 = Element.SetParameterByName(element=setParameterByName_5, parameterName=firstItem_6, value=dropItems_6)
firstItem_7 = List.FirstItem(list=code_block_2.out6)
dropItems_7 = List.DropItems(list=code_block_2.out6, amount=code_block_3)
setParameterByName_7 = Element.SetParameterByName(element=setParameterByName_6, parameterName=firstItem_7, value=dropItems_7)
firstItem_8 = List.FirstItem(list=code_block_2.out7)
dropItems_8 = List.DropItems(list=code_block_2.out7, amount=code_block_3)
setParameterByName_8 = Element.SetParameterByName(element=setParameterByName_7, parameterName=firstItem_8, value=dropItems_8)
firstItem_9 = List.FirstItem(list=code_block_2.out8)
dropItems_9 = List.DropItems(list=code_block_2.out8, amount=code_block_3)
setParameterByName_9 = Element.SetParameterByName(element=setParameterByName_8, parameterName=firstItem_9, value=dropItems_9)
firstItem_10 = List.FirstItem(list=code_block_2.out9)
dropItems_10 = List.DropItems(list=code_block_2.out9, amount=code_block_3)
setParameterByName_10 = Element.SetParameterByName(element=setParameterByName_9, parameterName=firstItem_10, value=dropItems_10)
firstItem_11 = List.FirstItem(list=code_block_2.out10)
dropItems_11 = List.DropItems(list=code_block_2.out10, amount=code_block_3)
setParameterByName_11 = Element.SetParameterByName(element=setParameterByName_10, parameterName=firstItem_11, value=dropItems_11)

# group: changing color bar
code_block_4 = CodeBlock { 0; 255; }  # frozen
byARGB = Color.ByARGB(red=code_block_4.out1)
byARGB_2 = Color.ByARGB(green=code_block_4.out1)
list_create = List.Create(item0=byARGB, item1=byARGB_2)
code_block_5 = CodeBlock { 0; 1; }  # frozen
remapRange = Math.RemapRange(newMin=code_block_5.out0, newMax=code_block_5.out1)  # unwired: numbers
color_range = ColorRange(colors=list_create, value=remapRange)  # unwired: indices
overrideColorInView = Element.OverrideColorInView(color=color_range)  # unwired: element

# group: Coloring block
# taking 20 mins
family_types_2 = FamilyTypes("block:block")
byFamilyType = FamilyInstance.ByFamilyType(familyType=family_types_2)
string = StringInput("cu")
getParameterValueByName = Element.GetParameterValueByName(element=byFamilyType, parameterName=string)
code_block_6 = CodeBlock { 0; 1; }
remapRange_2 = Math.RemapRange(numbers=getParameterValueByName, newMin=code_block_6.out0, newMax=code_block_6.out1)
color_range_2 = ColorRange(value=remapRange_2)  # unwired: colors, indices
overrideColorInView_2 = Element.OverrideColorInView(element=byFamilyType, color=color_range_2)
