# Dynamo graph UG2_tunnel_from_mesh.dyn "ug1" (Dynamo 2.17.0.3472)
# packages: Clockwork for Dynamo 2.x 2.4.0

select_model_element = DSModelElementSelection()  # 1 picked in the model
file_path = Filename(".\Faces.obj")
file_path_2 = Filename(".\mesh_test.csv")
python_script = Python(IN[0]=file_path, IN[1]=file_path_2)  # CPython3
# ---------- python_script.python (170 lines) ----------
# Import the required modules
import sys
import clr
clr.AddReference('ProtoGeometry')
from Autodesk.DesignScript.Geometry import *
sys.path.append(r'D:\Anaconda\envs\Dynamo3912\Lib\site-packages')
import open3d as o3d
import numpy as np
import pandas as pd
from scipy.interpolate import CubicSpline
import math

meshsample = o3d.io.read_triangle_mesh(IN[0])
DesignWidth = 5500
DesignHeight = 4500

df = pd.read_csv(IN[1])
df[["x", "y", "z"]] = df[["x", "y", "z"]] * 1000
groupedcp = df.groupby('no').apply(lambda x: x[['x', 'y', 'z']].to_numpy())

def plane_param(point, n1):
    A = n1[0]
    B = n1[1]
    C = n1[2]
    D = -A * point[0] - B * point[1] - C * point[2]
    return A, B, C, D

def calculate_local_contour(mesh_vertices, mesh_triangles, center_point, normal_vector, distance):
    contour_vertices = []
    center_point = center_point+(0,0,distance/2)   
    min_x = center_point[0] - distance
    max_x = center_point[0] + distance
    min_y = center_point[1] - distance
    max_y = center_point[1] + distance
    min_z = center_point[2] - distance
    max_z = center_point[2] + distance   
    for triangle in mesh_triangles:
        vertex_indices = triangle[:3]
        vertices = mesh_vertices[vertex_indices]       
        if any((min_x <= vertex[0] <= max_x and
                min_y <= vertex[1] <= max_y and
                min_z <= vertex[2] <= max_z) for vertex in vertices):           
            intersections = []
            for i in range(3):
                start_vertex = vertices[i]
                end_vertex = vertices[(i + 1) % 3]
                start_distance = np.dot(start_vertex - center_point, normal_vector)
                end_distance = np.dot(end_vertex - center_point, normal_vector)
                if start_distance * end_distance < 0:
                    t = abs(start_distance) / (abs(start_distance) + abs(end_distance))
                    intersection = start_vertex + t * (end_vertex - start_vertex)
                    intersections.append(intersection)           
            if len(intersections) >= 2:
                contour_vertices.extend(intersections)  
    return np.array(contour_vertices)

def project_to_plane(point_cloud, center, normal):
    point_cloud = np.array(point_cloud) - np.array(center)
    projection = np.dot(point_cloud, normal)
    projected_points = point_cloud - np.outer(projection, normal)
    x_axis = np.array([-normal[1], normal[0], 0])
    x_axis = x_axis/np.linalg.norm(x_axis)
    y_axis = np.cross(normal, x_axis)
    x_coords = np.dot(projected_points, x_axis)
    y_coords = np.dot(projected_points, y_axis)
    return np.array(list(zip(x_coords, y_coords)))

def get_3dcoordinates_from_plane(point2d,plane_params,origin):
    xp,yp = point2d
    A,B,C,D = plane_params
    x0,y0,z0 = origin
    N = np.array([A, B, C])
    N = N / np.linalg.norm(N)
    
    Vx = -B
    Vy = A
    Vz = 0
    V = np.array([Vx, Vy, Vz])
    V = V / np.linalg.norm(V)
    
    U = np.cross(N, V)
    U = U / np.linalg.norm(U)
    
    x = x0+xp*V[0]+yp*U[0]
    y = y0+xp*V[1]+yp*U[1]
    z = z0+xp*V[2]+yp*U[2]
    
    return [x,y,z]

def chunk_list(points):
    chunked_list = []
    num_chunks = math.ceil((len(points)-4)/8)
    for i in range(num_chunks):
        start_index = i*8
        end_index = (i+1)*8 + 4
        current_chunk = points[start_index:end_index]
        chunked_list.append(current_chunk)

    return chunked_list

ada_points_3d = []
num = df['no'].nunique()
MeshVertices = np.asarray(meshsample.vertices)*1000
MeshTriangles = np.asarray(meshsample.triangles)

for k in range(num):
    cp = groupedcp.values[k]
    count = cp.shape[0]
    
    # Compute a cubic spline curve
    t = range(count)
    cs = CubicSpline(t, cp, bc_type='natural')

    # Compute the tangent vectors at each point
    derivatives = cs(t, 1)
    tangents = derivatives / np.linalg.norm(derivatives, axis=1)[:, np.newaxis]
    
    # Calculate local contour and obtain parameters
    Distance = (DesignWidth**2+DesignHeight**2)**(0.5)
    
    RealWidth = []
    RealHeight = []
    
    for i in range(count):
        ContourVertices = np.unique(calculate_local_contour(MeshVertices, MeshTriangles, cp[i], tangents[i], Distance),axis=0)
        point2d = project_to_plane(ContourVertices,cp[i], tangents[i])

        p1 = np.array([x[0] for x in point2d])
        dis_p1 = round(p1.max() - p1.min(),3)
        if dis_p1 > (DesignWidth+1500):
            RealWidth.append(DesignWidth)
        else:
            RealWidth.append(dis_p1)

        p2 = np.array([y[1] for y in point2d])
        dis_p2 = round(p2.max() - p2.min(),3)
        if dis_p2 > (DesignHeight+1500):
            RealHeight.append(DesignHeight)
        else:
            RealHeight.append(dis_p2)
    
    SlidePlane = []
    for i in range(count):
        point0 = cp[i]
        a, b, c, d = plane_param(point0, tangents[i])
        plane0 = [a,b,c,d]
        SlidePlane.append(plane0)
              
    ada_points_3d_tem2=[]
    ada_points_3d_tem3=[]
    for i in range(len(cp)):
    # Four points corresponding to adaptive families
        point1 = [-RealWidth[i]/2,RealHeight[i]]
        point2 = [-RealWidth[i]/2,0]
        point3 = [RealWidth[i]/2,0]
        point4 = [RealWidth[i]/2,RealHeight[i]]
        ada_points = np.array([point1,point2,point3,point4])
        for j in range(4):
            plane_params = SlidePlane[i]
            origin = cp[i]
            ada_points_3d_tem1 = get_3dcoordinates_from_plane(ada_points[j], plane_params, origin)
            ada_points_3d_tem2.append(ada_points_3d_tem1)
    ada_points_3d_tem3 = chunk_list(ada_points_3d_tem2)

    # Group every three cross-section
    ada_points_3d.extend(ada_points_3d_tem3)

output = [i for j in ada_points_3d for i in j]
    
OUT = output
# ----------------------------------------
transpose = List.Transpose(lists=python_script)
string_from_object = FromObject(object=transpose)
toNumber = String.ToNumber(string=string_from_object)
code_block = CodeBlock(x=toNumber) { x[0]; x[1]; x[2]; }
byCoordinates = Point.ByCoordinates(x=code_block.out0, y=code_block.out1, z=code_block.out2)
python_script_2 = Python(IN[0]=byCoordinates)  # CPython3
# ---------- python_script_2.python (13 lines) ----------
import sys
import clr
clr.AddReference('ProtoGeometry')
from Autodesk.DesignScript.Geometry import *

points_list = IN[0]

grouped_points = []

for i in range(0, len(points_list), 12):
    grouped_points.append(points_list[i:i+12])

OUT = grouped_points
# ----------------------------------------
family_types = FamilyTypes("tunnel_void_UG1:tunnel_void_UG1")
byPoints = AdaptiveComponent.ByPoints(points=python_script_2, familyType=family_types)
cutGeometry = Custom[Element.CutGeometry](elementToBeCut=select_model_element, cuttingElement=byPoints)  # package Clockwork for Dynamo 2.x; Adds a solid-solid cut for two model elements (if possible).
